# Grasshopper definition XPBF.gh (Grasshopper 1.0.7)
# plug-ins: Kangaroo2 Components

number_slider = Slider(30, range=0..100)
number_slider_2 = Slider(30, range=0..100)
xy_plane = XYPlane(Origin=Point(0, 0, 0))
construct_domain = ConstructDomain(DomainStart=expr("-x", number_slider_2), DomainEnd=number_slider_2)
construct_domain_2 = ConstructDomain(DomainStart=expr("-x", number_slider), DomainEnd=number_slider)
point = Point(xy_plane)
rectangle = Rectangle(Plane=point, XSize=construct_domain, YSize=construct_domain_2, Radius=0)  # -> Rectangle, Length
rectangle_2 = Rectangle(rectangle.Rectangle)
circle = Circle(Plane=point, Radius=Slider(20, range=0..100))
region_intersection = RegionIntersection(CurvesA=circle, CurvesB=rectangle_2)
triremesh = TriRemesh(Geometry=region_intersection, Length=Slider(0.7, range=0..1), Iterations=15)  # -> Triangulation, Dual, Creases
deconstruct_domain = DeconstructDomain(Domain=construct_domain_2)  # -> Start, End
deconstruct_domain_2 = DeconstructDomain(Domain=construct_domain)  # -> Start, End
deconstruct_mesh = DeconstructMesh(Mesh=triremesh.Triangulation)  # -> Vertices, Faces, Colours, Normals

number_slider_3 = Slider(10, range=0..10)
negative = Negative(Value=Slider(17, range=0..100))

deconstruct = Deconstruct(Point=deconstruct_mesh.Vertices)  # -> XComponent, YComponent, ZComponent
trigger = Trigger(Interval=10, TimerInterval=10, Target=c_script)
c_script = CSharpScript(
    particlesX=deconstruct.XComponent,
    particlesY=deconstruct.YComponent,
    restDensity=Slider(1.64, range=0..10),
    compliance=Slider(0.0001, range=0..10),
    damping=Slider(0.6, range=0..1),
    smoothRadius=Slider(2, range=0..10),
    artificialK=Slider(0.001, range=0..0.001),
    artificialN=Slider(6, range=0..10),
    deltaQFactor=Slider(0.25, range=0..1),
    gravity=negative,
    minX=deconstruct_domain_2.Start,
    maxX=deconstruct_domain_2.End,
    minY=deconstruct_domain.Start,
    maxY=deconstruct_domain.End,
    iters=Slider(30, range=0..100),
    dt=Slider(0.003, range=0..0.1),
    reset=Button(),
    Reference="C:\Users\yangw\Desktop\XPBF_PROJECT\XPBF\XPBF\bin\Release\XPBF.dll")  # -> out, A, B; inputs particlesX: list of Double, particlesY: list of Double, restDensity: Double, compliance: Double, damping: Double, smoothRadius: Double, artificialK: Double, artificialN: Int32, deltaQFactor: Double, gravity: Double, minX: Double, maxX: Double, minY: Double, maxY: Double, iters: Int32, dt: Double, reset: Boolean
# ---------- c_script: C# usings ----------
using XPBF;
using XPBF.SpatialHash;
# ---------- c_script: C# ----------
    if(reset || !init)
    {
      init = true;
      reset = true;
      var x = particlesX.ToArray();
      var y = particlesY.ToArray();
      var ps = XPBF.XPBF.PositionsToParticles(x, y, restDensity, damping, compliance);
      P = new XPBF.XPBF((float) minX, (float) minY, (float) maxX, (float) maxY, (float) gravity, (float) dt, (float) smoothRadius, ps, (float) artificialK, (float) artificialN, (float) deltaQFactor);

      A = P.posX;
      B = P.posY;
    }
    else
    {
      for(int i = 0;i < iters;i++)
      {
        P.Step(1);
      }
      
      A = P.posX;
      B = P.posY;
    }
# ---------- c_script: C# additional code ----------
  bool init;
  XPBF.XPBF P;
# ---------- end c_script ----------
construct_point = ConstructPoint(XCoordinate=c_script.A, YCoordinate=c_script.B, ZCoordinate=0)
cloud_display = CloudDisplay(
    Points=construct_point,
    Colours=ColourSwatch(SwatchColor=RGB(255, 255, 255)),
    Size=Slider(0.15, range=0..1),
    SpriteType=0)
